# Grasshopper definition 2211.gh (Grasshopper 0.9.75)
# plug-ins: Python Interpreter

number_slider = Slider(250000, range=0..250000)
python_script = PythonScript(x=number_slider)  # -> out, a
# ---------- python_script: Python ----------
import math


f= int(math.sqrt(x))
a = "("+str(f)+","+str(f)+")"
# ---------- end python_script ----------
ghpl_np_linspace = GHPL_npLinSpace(start=Slider(20, range=-20..100), stop=Slider(0, range=0..100), num=number_slider, refresh=Button())  # -> out, Log, Array, shape; inputs num: Int32
# ---------- ghpl_np_linspace: Python ----------
# -*- coding: utf-8 -*-
"""
Created on Fri Jun 16 08:45:09 2017

@author: Mahmoud M. Abdelrahman
"""

ghenv.Component.Name = "GHPL_np.LinSpace"
ghenv.Component.Description ="Return evenly spaced numbers over a specified interval.\nReturns num evenly spaced samples, calculated over the interval [start, stop ].\nThe endpoint of the interval can optionally be excluded."
ghenv.Component.Message = "np.linspace"
ghenv.Component.IconDisplayMode = ghenv.Component.IconDisplayMode.icon
ghenv.Component.Category = "GhPlotLib"

import System
import os
import time

def main(start, end, steps, workingDir):
    '''
    
    
    
    '''
    LogfileName = "npLinspaceTxt.txt"
    
    
    fileName = "npLinspace_Work"+System.DateTime.Now.ToString("yyyymmddMMss")+".py"

    timenow = System.DateTime.Now.ToString("yyyyMMdd")
    
    
    if(workingDir == None): workingDir = "C:\\GHPlotLib\\TEMP\\"+timenow+"\\"
    
    
    if(not System.IO.Directory.Exists(workingDir)):System.IO.Directory.CreateDirectory(workingDir)
    
    replaceList = {"##start##":float(start), "##end##":float(end), "##steps##": int(steps), "##workingDir##": workingDir.replace("\\", "\\\\"), }
    
    
    txt = replaces(replaceList)
    
    
    pythonWriteFile = open(workingDir+fileName, 'w')
    
    
    pythonWriteFile.write(txt)
    
    
    pythonWriteFile.close()
    
    
    runProcess(workingDir, fileName)
    
    
    
    datafiles = readfiles(workingDir, LogfileName)
    
    
    return datafiles


def replaces(ListOfReplaces):
    txt = ""
    pythonFileLoad = open("C:\\GHPlotLib\\PythonInits\\npLinSpace.py",'r')
    txt = pythonFileLoad.read()
    
    for key, value in ListOfReplaces.iteritems():
        txt = txt.replace(str(key), str(value))
    pythonFileLoad.close()
    return txt


def runProcess(workingDir, filename):
    os.startfile(workingDir.replace("\\", "\\\\")+filename)
    g = readfiles(workingDir,filename)
    return g

def readfiles(workingDir, filename):
    for i in range(10000):
        if(System.IO.File.Exists(workingDir+filename)):
            f1 = open(workingDir+filename, 'r')
            data1 = f1.read()
            data2 = workingDir+"npLinspaceDump.txt"
            f1.close()
            return (data1, data2)
        else:
            time.sleep(0.0001)
    return ("Error in inputData", "")

if( _start == None or _stop == None or _num == None):
    a = "Fill in the data"
else:
    Log_, Array_ = main(_start, _stop, _num, _workingDir_)
# ---------- end ghpl_np_linspace ----------
ghpl_np_linspace_2 = GHPL_npLinSpace(start=Slider(0, range=0..100), stop=Slider(15, range=0..100), num=number_slider, refresh=Button())  # -> out, Log, Array, shape; inputs num: Int32; same code as ghpl_np_linspace
ghpl_function_x_y = GHPL_functionXY(x=ghpl_np_linspace_2.Array, y=ghpl_np_linspace.Array, function="0.5*np.sin(0.05*x*y)*np.cos(x)/2*-y")  # -> Log, F_of_X
# ---------- ghpl_function_x_y: Python ----------
# -*- coding: utf-8 -*-
"""
Created on Sat Jun 17 14:11:35 2017
@author: Mahmoud M. Abdelrahman
GHPL_function(x,y)
"""
name = "GHPL_function(x,y)"
date = "17-JUN-2017"
ghenv.Component.Name = name
ghenv.Component.Description ="Returns a function of group of variables"
ghenv.Component.Message = name + "\n"+date
ghenv.Component.IconDisplayMode = ghenv.Component.IconDisplayMode.icon
ghenv.Component.Category = "GhPlotLib"

import System
import os
import time
import scriptcontext as sc

wait = True
def main(_x, function, workingDir, _y = "", _z = "", _u = "", _v = "", _w = ""):
    
    
    
    LogfileName = name+"_Txt.txt"
    fileNameString = name+randomName()
    
    fileName = name+"_Work"+System.DateTime.Now.ToString("yyyymmddMMss")+".py"
    
    
    timenow = System.DateTime.Now.ToString("yyyyMMdd")
    
    
    if(workingDir == None): workingDir = "C:\\GHPlotLib\\TEMP\\"+timenow+"\\"
    
    
    if(not System.IO.Directory.Exists(workingDir)):System.IO.Directory.CreateDirectory(workingDir)
    
    
    replaceList = {
    "##x##":str(_x).replace("\\", "\\\\"),
    "##y##":str(_y).replace("\\", "\\\\"),
    "##z##":str(_z).replace("\\", "\\\\"),
    "##u##":str(_u).replace("\\", "\\\\"),
    "##v##":str(_v).replace("\\", "\\\\"),
    "##w##":str(_w).replace("\\", "\\\\"),
    "##function##":function,
    "##workingDir##": workingDir.replace("\\", "\\\\"),
    "##fileNameString##":fileNameString}
    
    
    txt = replaces(replaceList)
    
    pythonWriteFile = open(workingDir+fileName, 'w')
    
    
    pythonWriteFile.write(txt)
    
    
    pythonWriteFile.close()
    
    
    runProcess(workingDir, fileName)
    
    
    
    datafiles = readfiles(workingDir, fileNameString)
    
    print fileNameString
    print datafiles[1]
    
    
    return datafiles


def replaces(ListOfReplaces):
    txt = ""
    pythonFileLoad = open("C:\\GHPlotLib\\PythonInits\\"+name+"_Plt.py",'r')
    txt = pythonFileLoad.read()
    
    for key, value in ListOfReplaces.iteritems():
        txt = txt.replace(str(key), str(value))
    pythonFileLoad.close()
    return txt


def randomName():
    a= System.DateTime.Now.ToString("yyyyMMffff")
    return a


def runProcess(workingDir, _filename):
    os.startfile(workingDir.replace("\\", "\\\\")+_filename)
    time.sleep(0.5)



def readfiles(workingDir, _filename):
    for i in range(15000):
        if(System.IO.File.Exists(workingDir+_filename+"_Txt.txt")):
            f1 = open(workingDir+_filename+"_Txt.txt", 'r')
            data1 = f1.read()
            data2 = workingDir+_filename+"_Dump.txt"
            f1.close()
            return (data1, data2)
        else:
            time.sleep(0.0001)
    return ("Error in inputData", "")


if(x == None or _function ==None):
    pass
else:
    Log_, F_of_X_ = main(x,_function, _workingDir_, y, z, u, v, w)
# ---------- end ghpl_function_x_y ----------
ghpl_reshapearray = GHPL_ReshapeArray(InputArray=ghpl_function_x_y.F_of_X, Reshape="(50,5000)")  # -> Log, OutputArray
# ---------- ghpl_reshapearray: Python ----------
# -*- coding: utf-8 -*-
"""
Created on Sat Jun 17 17:49:01 2017
@author: Mahmoud M. AbdleRahman
"""

name = "GHPL_ReshapeArray"
date = "17-JUN-2017"
ghenv.Component.Name = name
ghenv.Component.Description ="Reshapes a given array"
ghenv.Component.Message = name + "\n"+date
ghenv.Component.IconDisplayMode = ghenv.Component.IconDisplayMode.icon
ghenv.Component.Category = "GhPlotLib"

import System
import os
import time

wait = True
def main(input, reshape, workingDir):
    
    
    
    LogfileName = name+"_Txt.txt"
    fileNameString = name+randomName()
    
    fileName = name+"_Work"+System.DateTime.Now.ToString("yyyymmddMMss")+".py"
    
    
    timenow = System.DateTime.Now.ToString("yyyyMMdd")
    
    
    if(workingDir == None): workingDir = "C:\\GHPlotLib\\TEMP\\"+timenow+"\\"
    
    
    if(not System.IO.Directory.Exists(workingDir)):System.IO.Directory.CreateDirectory(workingDir)
    
    
    replaceList = {
    "##inputArray##":str(input).replace("\\", "\\\\"),
    "##shape##":reshape,
    "##workingDir##": workingDir.replace("\\", "\\\\"),
    "##fileNameString##":fileNameString}
    
    
    txt = replaces(replaceList)
    
    pythonWriteFile = open(workingDir+fileName, 'w')
    
    
    pythonWriteFile.write(txt)
    
    
    pythonWriteFile.close()
    
    
    runProcess(workingDir, fileName)
    
    
    
    datafiles = readfiles(workingDir, fileNameString)
    
    print fileNameString
    print datafiles[1]
    
    
    return datafiles


def replaces(ListOfReplaces):
    txt = ""
    pythonFileLoad = open("C:\\GHPlotLib\\PythonInits\\"+name+"_Plt.py",'r')
    txt = pythonFileLoad.read()
    for key, value in ListOfReplaces.iteritems():
        txt = txt.replace(str(key), str(value))
    pythonFileLoad.close()
    return txt


def randomName():
    a= System.DateTime.Now.ToString("yyyyMMffff")
    return a


def runProcess(workingDir, _filename):
    os.startfile(workingDir.replace("\\", "\\\\")+_filename)
    time.sleep(0.5)



def readfiles(workingDir, _filename):
    for i in range(15000):
        if(System.IO.File.Exists(workingDir+_filename+"_Txt.txt")):
            print "found"
            f1 = open(workingDir+_filename+"_Txt.txt", 'r')
            data1 = f1.read()
            data2 = workingDir+_filename+"_Dump.txt"
            f1.close()
            return (data1, data2)
        else:
            time.sleep(0.0001)
    return ("Error in inputData", "")




if(_InputArray == None or _Reshape==None):
    pass
else:
    Log_, OutputArray_ = main(_InputArray,_Reshape, _workingDir_)
# ---------- end ghpl_reshapearray ----------
panel = Panel(ghpl_reshapearray.Log)
ghpl_pcolor = GHPL_Pcolor(inputData=ghpl_reshapearray.OutputArray)  # -> Log, plot; inputs colorMap: Int32, shading: Int32
# ---------- ghpl_pcolor: Python ----------
# -*- coding: utf-8 -*-
"""
Created on Sat Jun 17 04:36:30 2017
@author: Mahmoud M. Abdelrahman
GHPL_PColor
"""

name = "GHPL_Pcolor"
ghenv.Component.Name = name
ghenv.Component.Message = "PlotMeshGrid\nmatplotlib.pcolor()"


import System
import os
import time


def main(input,  workingDir , colormap = 0):
    ColMap = colorMap(colormap)
    
    LogfileName = name+"_Txt.txt"
    
    
    fileName = name+"_Work"+System.DateTime.Now.ToString("yyyymmddMMss")+".py"
    
    
    timenow = System.DateTime.Now.ToString("yyyyMMdd")
    
    
    if(workingDir == None): workingDir = "C:\\GHPlotLib\\TEMP\\"+timenow+"\\"
    
    
    if(not System.IO.Directory.Exists(workingDir)):System.IO.Directory.CreateDirectory(workingDir)
    
    replaceList = {"##input##":input.replace("\\", "\\\\"), "##cmap##":ColMap, "##workingDir##": workingDir.replace("\\", "\\\\"), }
    
    
    txt = replaces(replaceList)
    
    pythonWriteFile = open(workingDir+fileName, 'w')
    
    
    pythonWriteFile.write(txt)
    
    
    pythonWriteFile.close()
    
    
    runProcess(workingDir, fileName)
    
    
    
    datafiles = readfiles(workingDir, LogfileName)
    
    
    return workingDir+"fig_.png"


def replaces(ListOfReplaces):
    txt = ""
    pythonFileLoad = open("C:\\GHPlotLib\\PythonInits\\"+name+"_Plt.py",'r')
    txt = pythonFileLoad.read()
    
    for key, value in ListOfReplaces.iteritems():
        txt = txt.replace(str(key), str(value))
    pythonFileLoad.close()
    return txt


def runProcess(workingDir, filename):
    os.startfile(workingDir.replace("\\", "\\\\")+filename)
    g = readfiles(workingDir,filename)
    return g

def readfiles(workingDir, filename):
    if(System.IO.File.Exists(workingDir+filename)):
        f1 = open(workingDir+filename, 'r')
        data1 = f1.read()
        data2 = workingDir+name+"_Dump.txt"
        f1.close()
        return (data1, data2)
    else:
        return ["", ""]


def colorMap(cm = 0):
    if(cm == None):
        cm = 0
    cmap = ('hsv','gist_earth','terrain','ocean','gist_stern',
                             'brg','CMRmap','cubehelix',
                             'gnuplot', 'gnuplot2', 'gist_ncar',
                             'nipy_spectral', 'jet', 'rainbow',
                             'gist_rainbow', 'flag', 'prism')
    return cmap[cm]


if(_inputData==None):
    Log_ = "you should enter _input data"
else:
    plot_ = main(_inputData, _workingDir_, _colorMap_)
# ---------- end ghpl_pcolor ----------
ghpl_contourf = GHPL_contourf(inputData=ghpl_reshapearray.OutputArray, levels=Slider(50, range=0..100))  # -> Log, plot; inputs colorMap: Int32, shading: Int32
# ---------- ghpl_contourf: Python ----------
# -*- coding: utf-8 -*-
"""
Created on Sat Jun 17 04:36:30 2017
@author: Mahmoud M. Abdelrahman
GHPL_contourf
"""

name = "GHPL_contourf"
ghenv.Component.Name = name
ghenv.Component.Message = "Plot filled contour \nmatplotlib.contourf()"


import System
import os
import time


def main(input,  workingDir , colormap = 0, levels = 10):
    ColMap = colorMap(colormap)
    if (levels == None): levels = 10
    LogfileName = name+"_Txt.txt"
    
    
    fileName = name+"_Work"+System.DateTime.Now.ToString("yyyymmddMMss")+".py"
    
    
    timenow = System.DateTime.Now.ToString("yyyyMMdd")
    
    
    if(workingDir == None): workingDir = "C:\\GHPlotLib\\TEMP\\"+timenow+"\\"
    
    
    if(not System.IO.Directory.Exists(workingDir)):System.IO.Directory.CreateDirectory(workingDir)
    
    replaceList = {"##input##":input.replace("\\", "\\\\"), "##cmap##":ColMap, "##workingDir##": workingDir.replace("\\", "\\\\"), "##levels##":levels, "##fileNameString##":name }
    
    
    txt = replaces(replaceList)
    
    pythonWriteFile = open(workingDir+fileName, 'w')
    
    
    pythonWriteFile.write(txt)
    
    
    pythonWriteFile.close()
    
    
    runProcess(workingDir, fileName)
    
    
    
    datafiles = readfiles(workingDir, LogfileName)
    
    
    return workingDir+name+"_fig_.png"


def replaces(ListOfReplaces):
    txt = ""
    pythonFileLoad = open("C:\\GHPlotLib\\PythonInits\\"+name+"_Plt.py",'r')
    txt = pythonFileLoad.read()
    
    for key, value in ListOfReplaces.iteritems():
        txt = txt.replace(str(key), str(value))
    pythonFileLoad.close()
    return txt


def runProcess(workingDir, filename):
    os.startfile(workingDir.replace("\\", "\\\\")+filename)
    g = readfiles(workingDir,filename)
    return g

def readfiles(workingDir, filename):
    if(System.IO.File.Exists(workingDir+filename)):
        f1 = open(workingDir+filename, 'r')
        data1 = f1.read()
        data2 = workingDir+name+"_Dump.txt"
        f1.close()
        return (data1, data2)
    else:
        return ["", ""]


def colorMap(cm = 0):
    if(cm == None):
        cm = 0
    cmap = ('hsv','gist_earth','terrain','ocean','gist_stern',
                             'brg','CMRmap','cubehelix',
                             'gnuplot', 'gnuplot2', 'gist_ncar',
                             'nipy_spectral', 'jet', 'rainbow',
                             'gist_rainbow', 'flag', 'prism')
    return cmap[cm]


if(_inputData==None):
    Log_ = "you should enter _input data"
else:
    plot_ = main(_inputData, _workingDir_, _colorMap_, _levels_)
# ---------- end ghpl_contourf ----------
ghpl_contourf_2 = GHPL_contour(inputData=ghpl_reshapearray.OutputArray, colorMap=Slider(10, range=0..100))  # -> Log, plot; inputs colorMap: Int32, shading: Int32
# ---------- ghpl_contourf_2: Python ----------
# -*- coding: utf-8 -*-
"""
Created on Sat Jun 17 04:36:30 2017
@author: Mahmoud M. Abdelrahman
GHPL_contour
"""

name = "GHPL_contour"
ghenv.Component.Name = name
ghenv.Component.Message = "Plot contour lines \nmatplotlib.contour()"


import System
import os
import time


def main(input,  workingDir , colormap = 0, levels = 10):
    ColMap = colorMap(colormap)
    if (levels == None): levels = 10
    LogfileName = name+"_Txt.txt"
    
    
    fileName = name+"_Work"+System.DateTime.Now.ToString("yyyymmddMMss")+".py"
    
    
    timenow = System.DateTime.Now.ToString("yyyyMMdd")
    
    
    if(workingDir == None): workingDir = "C:\\GHPlotLib\\TEMP\\"+timenow+"\\"
    
    
    if(not System.IO.Directory.Exists(workingDir)):System.IO.Directory.CreateDirectory(workingDir)
    
    replaceList = {"##input##":input.replace("\\", "\\\\"), "##cmap##":ColMap, "##workingDir##": workingDir.replace("\\", "\\\\"), "##levels##":levels, "##fileNameString##":name }
    
    
    txt = replaces(replaceList)
    
    pythonWriteFile = open(workingDir+fileName, 'w')
    
    
    pythonWriteFile.write(txt)
    
    
    pythonWriteFile.close()
    
    
    runProcess(workingDir, fileName)
    
    
    
    datafiles = readfiles(workingDir, LogfileName)
    
    
    return workingDir+name+"_fig_.png"


def replaces(ListOfReplaces):
    txt = ""
    pythonFileLoad = open("C:\\GHPlotLib\\PythonInits\\"+name+"_Plt.py",'r')
    txt = pythonFileLoad.read()
    
    for key, value in ListOfReplaces.iteritems():
        txt = txt.replace(str(key), str(value))
    pythonFileLoad.close()
    return txt


def runProcess(workingDir, filename):
    os.startfile(workingDir.replace("\\", "\\\\")+filename)
    g = readfiles(workingDir,filename)
    return g

def readfiles(workingDir, filename):
    if(System.IO.File.Exists(workingDir+filename)):
        f1 = open(workingDir+filename, 'r')
        data1 = f1.read()
        data2 = workingDir+name+"_Dump.txt"
        f1.close()
        return (data1, data2)
    else:
        return ["", ""]


def colorMap(cm = 0):
    if(cm == None):
        cm = 0
    cmap = ('hsv','gist_earth','terrain','ocean','gist_stern',
                             'brg','CMRmap','cubehelix',
                             'gnuplot', 'gnuplot2', 'gist_ncar',
                             'nipy_spectral', 'jet', 'rainbow',
                             'gist_rainbow', 'flag', 'prism')
    return cmap[cm]


if(_inputData==None):
    Log_ = "you should enter _input data"
else:
    plot_ = main(_inputData, _workingDir_, _colorMap_, _levels_)
# ---------- end ghpl_contourf_2 ----------
import_image = ImportImage(
    File=ghpl_contourf.plot,
    Rectangle={Plane=PlaneXY(-32.2081007, -7.684068875, 0), Size=Domain2(u=0..132.7756637, v=0..104.4478716)})
